# Grasshopper definition Multithreading Solid Difference.gh (Grasshopper 1.0.7)

# A-INPUT
# Color Definition
# Parent block saturation 0
# Sub-block saturation 100
# ! Key Variable
# 0,100,100,150
# 1stTitle100
# KEY DATA(!)
# 0,46,100,150
# 2ndTitle75
# Input / Slider
# 42,50,100,150
# 3rdTitle50
# Fuction
# 220,25,100,150
# 4thTitle_25
# Output  / Display
# 100,50,100,150
# Content_15
# Main Legend
# 0,100,100,150
# Main Block(D)
# 65,60,100,150
# Test Block
# 295,60,100,150
# Rhino Screening Code
# 01選取封閉曲線指令
# SelClosedCrv
# 02選取曲面
# selmesh
# 03複製建立邊緣
# DupBorder
# 04反轉曲線_起始點和終點
# Flip curve
# 05選取圖快
# SelBlockInstance
# Plug-in List
# 1.
# 2.
number_slider = Slider(4, range=0..100)
number_slider_2 = Slider(1, range=0..100)
# 20210608_Sample File3.2
geo = Geometry([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])
partition = PartitionList(List=geo, Size=number_slider)
geo_2 = Geometry(partition)
vec = VectorXYZ(XComponent=number_slider_2, YComponent=number_slider_2, ZComponent=number_slider_2)  # -> Vector, Length
move = Move(Geometry=geo_2, Motion=vec.Vector)  # -> Geometry, Transform
# B-FUCTION
# C-OUTPUT
# 1
# 2
# 3
# 4
# New Battery
# Positive values must be
# shifted upwards.
sdiff = SolidDifference(BrepsA=geo_2, BrepsB=move.Geometry)
c_script = CSharpScript(brepsA=geo_2, brepsB=move.Geometry)  # -> out, result; inputs brepsA: list of Brep, brepsB: list of Brep
# ---------- c_script: C# usings ----------
using System.Threading;
using System.Threading.Tasks;
# ---------- c_script: C# ----------
    List<Brep> differenceBreps = new List<Brep>();

    Parallel.ForEach<Brep>(brepsA, brepA =>
      {
      List<Brep> tempDiffBreps = new List<Brep>();

      foreach (Brep brepB in brepsB)
      {
        Brep[] diff = Brep.CreateBooleanDifference(brepA, brepB, RhinoDoc.ActiveDoc.ModelAbsoluteTolerance);
        if (diff != null && diff.Length > 0)
        {
          tempDiffBreps.AddRange(diff);
        }
      }

      lock (differenceBreps)
      {
        differenceBreps.AddRange(tempDiffBreps);
      }
      });

    result = differenceBreps;
# ---------- end c_script ----------
# 5
brep = Brep(c_script.result)
