# Grasshopper definition changeRhinoBackGround.gh (Grasshopper 1.0.7)

# 20210608_Sample File3.2
# B-FUCTION
# A-INPUT
# Color Definition
# Parent block saturation 0
# Sub-block saturation 100
# ! Key Variable
# 0,100,100,150
# 1stTitle100
# 1
# KEY DATA(!)
# 0,46,100,150
# 2ndTitle75
# Input / Slider
# 42,50,100,150
# 3rdTitle50
# New Battery
# Fuction
# 220,25,100,150
# 4thTitle_25
# Positive values must be
# shifted upwards.
# Output  / Display
# 100,50,100,150
# Content_15
# Main Legend
# 0,100,100,150
# Main Block(D)
# 65,60,100,150
# Test Block
# 295,60,100,150
# Rhino Screening Code
swatch = ColourSwatch(SwatchColor=RGB(217, 78, 78))
# 01選取封閉曲線指令
# SelClosedCrv
# 02選取曲面
# selmesh
# 03複製建立邊緣
# DupBorder
# 04反轉曲線_起始點和終點
# Flip curve
# 05選取圖快
# SelBlockInstance
# Plug-in List
# 1.
# 2.
swatch_2 = ColourSwatch(SwatchColor=RGB(250, 150, 150))
# C-OUTPUT
# 2
# 3
# 4
# 5
c_script = CSharpScript(BackGroundColor=swatch, GridThickLineColor=ColourSwatch(SwatchColor=RGB(255, 255, 255)), GridThinLineColor=swatch_2)  # inputs BackGroundColor: Color, GridThickLineColor: Color, GridThinLineColor: Color
# ---------- c_script: C# ----------
    Rhino.ApplicationSettings.AppearanceSettings.ViewportBackgroundColor = BackGroundColor;
    Rhino.ApplicationSettings.AppearanceSettings.GridThickLineColor = GridThickLineColor;
    Rhino.ApplicationSettings.AppearanceSettings.GridThinLineColor = GridThinLineColor;
# ---------- end c_script ----------
